# Grasshopper definition GH_python_script.gh (Grasshopper 1.0.7)

python = GhPythonScript()  # -> out, line1, line2
# ---------- python: Python ----------
import rhinoscriptsyntax as rs

line_pattern = [1, -0.25, 0, -0.25, 1, -0.1, 0.25, -0.1]
line_pattern = line_pattern*6
angle1 = 30
base_point1 = [0,1,0]
pat_file1 = [angle1, base_point1, line_pattern]
angle2 = 90
base_point2 = [3,-5,0]
pat_file2 = [angle2, base_point2, line_pattern]


def draw_pattern(pattern, base_point):
    result = []
    offset = 0
    for line in pattern:
        if float(line) > 0:
            result.append(rs.AddLine([base_point[0]+offset,base_point[1],base_point[2]],[base_point[0]+offset+abs(line),base_point[1],base_point[2]]))
            offset = offset+abs(line)
        elif float(line) < 0:
            offset = offset+abs(line)
        else:
            result.append(rs.AddPoint([base_point[0]+offset,base_point[1],base_point[2]]))
    return result
    
def rotate_pattern(pat_file):
    angle = pat_file[0]
    base_point = pat_file[1]
    line_pattern = pat_file[2]
    return rs.RotateObjects(draw_pattern(line_pattern, base_point), base_point, angle, None, True)


line1 = rotate_pattern(pat_file1)
line2 = rotate_pattern(pat_file2)
# ---------- end python ----------

# ---- group: WIP_node
python_2 = GhPythonScript()  # -> out, a
# ---------- python_2: Python ----------
__author__ = "macbook"

import rhinoscriptsyntax as rs

line_pattern = [1, -0.25, 0, -0.25, 1, -0.1]
line_pattern = line_pattern*3
angle1 = 45
angle2 = 70
angle3 = 30
base_point = [0,1,0]
pat_file1 = [angle1, base_point, line_pattern]
pat_file2 = [angle2, base_point, line_pattern]
pat_file3 = [angle3, base_point, line_pattern]
pat_file = [pat_file1, pat_file2, pat_file3]
'''
def draw_pattern(pattern, base_point):
    b = []
    offset = 0
    for line in pattern:
        if float(line) > 0:
            b.append(rs.AddLine([offset,base_point[1],base_point[2]],[offset+abs(line),base_point[1],base_point[2]]))
            offset = offset+abs(line)
        elif float(line) < 0:
            offset = offset+abs(line)
        else:
            b.append(rs.AddPoint([offset,base_point[1],base_point[2]]))
    return b
    
def draw_hatch_pattern(pat_file):
    result = []
    for pat in pat_file:
        angle = pat[0]
        base_point = pat[1]
        line_pattern = pat[2]
        result.append(rs.RotateObjects(draw_pattern(line_pattern, base_point), base_point, angle, None, True))
    return result
'''

def draw_pattern(pattern, base_point):
    a = []
    b = []
    offset = 0
    for line in pattern:
        if float(line) > 0:
            a.append([[offset,base_point[1],base_point[2]],[offset+abs(line),base_point[1],base_point[2]]])
            offset = offset+abs(line)
        elif float(line) < 0:
            offset = offset+abs(line)
        else:
            b.append([[offset,base_point[1],base_point[2]]])
    return a
    
'''
def draw_hatch_pattern(pat_file):
    result = []
    for pat in pat_file:
        angle = pat[0]
        base_point = pat[1]
        line_pattern = pat[2]
        result.append(rs.RotateObjects(draw_pattern(line_pattern, base_point), base_point, angle, None, True))
    return result
'''
coordinates = draw_pattern(pat_file1, base_point)
a = []
for points in coordinates:
    a = a.append(rs.AddLine(points))
#a = draw_hatch_pattern(pat_file)
#a = [pat_file[0], rs.AddPoint(pat_file[1])]
#a.append(draw_pattern(line_pattern, base_point))
#a = draw_pattern(line_pattern, base_point)
# ---------- end python_2 ----------

# ----
panel = Panel(python_2.a)
panel_2 = Panel(python.line1)
